test file "test"

suite "AWFG_concept/AWFG/RT_CPU"

  suite "AWFG_concept_Harness1"

    case "Group 1" [baseline]
      model AWFG_concept, harness AWFG_concept_Harness1 (for AWFG_concept/AWFG/RT_CPU)
      signal scenario: Group 1

suite "AWFG_concept/AWFG"

  suite "AWFG_concept_Harness3"

    case "Test 1" [baseline]
      model AWFG_concept, harness AWFG_concept_Harness3 (for AWFG_concept/AWFG)
      signal scenario: Test 1

    case "Test 2" [baseline]
      model AWFG_concept, harness AWFG_concept_Harness3 (for AWFG_concept/AWFG)
      signal scenario: Test 2

    case "Test 3" [baseline]
      model AWFG_concept, harness AWFG_concept_Harness3 (for AWFG_concept/AWFG)
      signal scenario: Test 3

    case "Test 4" [baseline]
      model AWFG_concept, harness AWFG_concept_Harness3 (for AWFG_concept/AWFG)
      signal scenario: Test 4

    case "Test 5" [baseline]
      model AWFG_concept, harness AWFG_concept_Harness3 (for AWFG_concept/AWFG)
      signal scenario: Test 5

    case "Test 6" [baseline]
      model AWFG_concept, harness AWFG_concept_Harness3 (for AWFG_concept/AWFG)
      signal scenario: Test 6

    case "Test 7" [baseline]
      model AWFG_concept, harness AWFG_concept_Harness3 (for AWFG_concept/AWFG)
      signal scenario: Test 7

    case "Test 8" [baseline]
      model AWFG_concept, harness AWFG_concept_Harness3 (for AWFG_concept/AWFG)
      signal scenario: Test 8

    case "Test 9" [baseline]
      model AWFG_concept, harness AWFG_concept_Harness3 (for AWFG_concept/AWFG)
      signal scenario: Test 9